# Grasshopper definition generate-lenticular-object.gh (Grasshopper 1.0.7)
# plug-ins: Heteroptera, Human UI, Pufferfish, AviaryMacawGH, Human, EleFront, Mesh Pipe

not = GateNot(A=Button())
launchwin = LaunchWindow(Show=not, Name="Lenticle Object Generation", Width="450", Height="1000", ChildStatus=0, EnableHorizScroll=False)

# ----
# Step 2: Viewpoint & Material
panel = Panel("##**Step 2: Assign Viewpoints and Images**")
mdv = CreateMarkdownViewer(Text=panel)
separator = CreateSeparator(Thickness=0.5, Horizontal=True, Color=RGB(0, 0, 0), Height="50")

# ----
# All viewpoints
panel_2 = Panel("camera")
refname = ReferenceByName(ObjectName=panel_2, DisableAutoUpdate=False, OnlyReferenced=False, OnlyVisible=True)
id = Guid(reverse(refname))

# ----
# Step 1: Assign
panel_3 = Panel("##**Step 1: Assign Mesh To Transform**")
mdv_2 = CreateMarkdownViewer(Text=panel_3)
separator_2 = CreateSeparator(Thickness=0.5, Horizontal=True, Color=RGB(0, 0, 0), Height="50")

# ----
# Select on screen model
button = Button()

filepicker = CreateFilePicker(ButtonLabelText="Find Model", DialogType=0, MustExist=True, Filter="All Files|*.*")
button_2 = CreateButton(ButtonName="Import 3D Model", ButtonStyle=0)
values = ValueListener(Elements=filepicker, SomeProperty=True)  # -> Values, Indices
values_2 = ValueListener(Elements=button_2, SomeProperty=True)  # -> Values, Indices
python = GhPythonScript(fileName=values.Values, start=values_2.Values)  # -> out, resetSelection
# ---------- python: Python ----------
__author__ = "yunyizhu"
__version__ = "2020.07.09"


import scriptcontext as sc
import rhinoscriptsyntax as rs
import Rhino as rc

resetSelection = True

if start:
    sc.doc = rc.RhinoDoc.ActiveDoc
    commandString = "_-Import " + fileName + " _Enter _Enter"
    done = rs.Command(commandString)
    sc.doc = ghdoc
# ---------- end python ----------
adjustpos = AdjustElementPositioning(ElementsToAdjust=filepicker, AbsolutePositioning=False, Width=300)
or = GateOr(A=python.resetSelection, B=button)
selobj = ObjectsBySelection(Reset=or, LiveMode=False)
stack = CreateStack(UIElements=[filepicker, button_2], Horizontal=False)

# ----
# alternative: dominant color by popularity
col = Colour()
cset = CreateSet(List=col)  # -> Set, Map
mindex = MemberIndex(Member=cset.Set)  # -> Index, Count
int = Integer(mindex.Count)
sort = SortList(Keys=mindex.Count)  # -> reverse(Keys), ValuesA
item = ListItem(List=sort.Keys, Index=0, Wrap=True)
int_2 = Integer(item)
mindex_2 = MemberIndex(Set=int, Member=int_2)  # -> Index, Count
item_2 = ListItem(Index=mindex_2.Index, Wrap=True)
item_3 = ListItem(List=item_2, Index=0, Wrap=True)  # -> flatten(Item)

# ----
# Step 3: Lenses
panel_4 = Panel("##**Step 3: Generate Lenses**")
mdv_3 = CreateMarkdownViewer(Text=panel_4)

separator_3 = CreateSeparator(Thickness=0.5, Horizontal=True, Color=RGB(0, 0, 0), Height="50")

true_button = CreateTrueOnlyButton(ButtonName="Generate Lenses and Pattern", ButtonStyle=0)
values_3 = ValueListener(Elements=true_button, SomeProperty=True)  # -> Values, Indices

# ----
# Step 4: Bake
panel_5 = Panel("##**Step 4: Bake**")
mdv_4 = CreateMarkdownViewer(Text=panel_5)

button_3 = CreateButton(ButtonName="Bake object and lenses", ButtonStyle=0)
values_4 = ValueListener(Elements=button_3, SomeProperty=True)  # -> Values, Indices

# ----
# import material ui
panel_6 = Panel("browse image")
button_4 = CreateButton(ButtonName="assign", ButtonStyle=0)
filepicker_2 = CreateFilePicker(ButtonLabelText=panel_6, DialogType=0, MustExist=True, Filter="All Files|*.*")
values_5 = ValueListener(Elements=button_4, SomeProperty=True)  # -> Values, Indices
values_6 = ValueListener(Elements=filepicker_2, SomeProperty=True)  # -> Values, Indices
filter = StreamFilter(Gate=values_5.Values, Stream1=values_6.Values)
merge = Merge(Data1=filepicker_2)
stack_2 = CreateStack(UIElements=merge, Horizontal=False)
adjustelem = AdjustElementAppearance(ElementsToAdjust=stack_2, Background=RGB(237, 237, 237))

# ----
# camera anchors
mesh = Mesh(id)
medges = MeshEdges(Mesh=mesh)  # -> NakedEdges, InteriorEdges, NonManifoldEdges
item_4 = ListItem(List=medges.InteriorEdges, Index="374", Wrap=True)
item_5 = ListItem(List=medges.InteriorEdges, Index="538", Wrap=True)
center = Center(Geometry=item_4)  # -> flatten(Center), Dimension
center_2 = Center(Geometry=item_5)  # -> flatten(Center), Dimension

# ----
# preview object from viewpoint UI
lng = ListLength(List=id)
stack_3 = StackData(Data="turn to", Stack=lng)
button_5 = CreateButton(ButtonName=stack_3, ButtonStyle=0)
values_7 = ValueListener(Elements=button_5, SomeProperty=True)  # -> flatten(Values), Indices

# ----
# assign image button
panel_7 = Panel("assign image")
stack_4 = StackData(Data=panel_7, Stack=lng)
button_6 = CreateButton(ButtonName=stack_4, ButtonStyle=0)
values_8 = ValueListener(Elements=button_6, SomeProperty=True)  # -> flatten(Values), Indices

# ----
# assign material to viewpoint
true = Boolean(True)
mindex_3 = MemberIndex(Set=values_8.Values, Member=true)  # -> Index, Count
item_6 = ListItem(List=id, Index=mindex_3.Index, Wrap=True)
id_2 = Guid(item_6)
merge_2 = Merge(Data1=values_6.Values, Data2=id_2)  # -> flatten(Result)
lng_2 = ListLength(List=merge_2)
larger = LargerThan(FirstNumber=lng_2, SecondNumber=1)  # -> LargerThan, OrEqualTo
filter_2 = StreamFilter(Gate=larger.LargerThan, Stream1=merge_2)
rec = DataRecorder(filter_2, DataLimit=-10, RecordData=True)
panel_8 = Panel(rec)

# ----
# corresponding material (one before the ID)
panel_9 = Panel(rec)
txt = Text(id)
mindex_4 = MemberIndex(Set=panel_9, Member=txt)  # -> simplify(Index), Count
item_7 = ListItem(List=mindex_4.Index, Index=-1, Wrap=True)
x_minus_one = XMinusOne(NumberX=item_7)
item_8 = ListItem(List=panel_9, Index=x_minus_one, Wrap=False)  # -> flatten(Item)
panel_10 = Panel(item_8)

# ----
# assign material ui
panel_11 = Panel("no material")
image = CreateImage(ImageSource=item_8, ImageWidth=100, ImageHeight=100)  # -> flatten(Image)
null = NullItem(Item=image)  # -> NullFlags, InvalidFlags, Description
true_2 = Boolean(True)
mindex_5 = MemberIndex(Set=null.InvalidFlags, Member=true_2)  # -> Index, Count
stack_5 = StackData(Data=panel_11, Stack=mindex_5.Count)
label = CreateLabel(LabelText=stack_5, LabelSize=12, Justification=0)
nullrep = ReplaceNulls(Items=image, Replacements=label)  # -> Items, Count

# ----
# viewpoint label
listdexs = ListIndices(List=id)
len = Length(Curve=listdexs)
addition = Addition(A=listdexs, B=1)
larger_2 = LargerThan(FirstNumber=len, SecondNumber=0)  # -> LargerThan, OrEqualTo
concat = Concatenate(FragmentA="Viewpoint #", FragmentB=addition)
filter_3 = StreamFilter(Gate=larger_2.LargerThan, Stream1=concat)
label_2 = CreateLabel(LabelText=filter_3, LabelSize=18, Justification=0)

adjustpos_2 = AdjustElementPositioning(ElementsToAdjust=label_2, Margin="0,15,0,0", AbsolutePositioning=False, Width=450, HorizontalAlignment=0)
merge_3 = Merge(Data1=mdv_2, Data2=stack, Data3=separator_2)
adjustpos_3 = AdjustElementPositioning(ElementsToAdjust=[button_5, button_6], Margin="30,5,5,5", AbsolutePositioning=False, HorizontalAlignment=0)

# ----
# stacking ui
merge_4 = Merge(Data1=simplify(graft(button_5)), Data2=simplify(graft(button_6)))  # -> simplify(Result)
stack_6 = CreateStack(UIElements=merge_4, Horizontal=False)
merge_5 = Merge(Data1=simplify(graft(nullrep.Items)), Data2=simplify(graft(stack_6)))  # -> simplify(Result)
stack_7 = CreateStack(UIElements=merge_5, Horizontal=True)

merge_6 = Merge(Data1=mdv_3, Data3=true_button, Data5=separator_3)
merge_7 = Merge(Data1=mdv_4, Data2=button_3)

# ----
# [3D -> 2D] selected viewpoint index
timer = Timer(TimerInterval=200, Target=selobj_2)
selobj_2 = ObjectsBySelection(Reset=Toggle(True), LiveMode=False)
id_3 = Guid(selobj_2)
txt_2 = Text(id_3)
mindex_6 = MemberIndex(Set=txt, Member=txt_2)  # -> Index, Count

# ----
# display file search logic
true_3 = Boolean(True)
mindex_7 = MemberIndex(Set=values_8.Values, Member=true_3)  # -> flatten(Index), Count
merge_8 = Merge(Data1=simplify(graft(label_2)), Data2=simplify(graft(stack_7)))  # -> simplify(Result)
rec_2 = DataRecorder(mindex_7.Index, DataLimit=-10, RecordData=True)
clean = CleanTree(RemoveNulls=True, RemoveInvalid=True, RemoveEmpty=False, Tree=merge_8)
item_9 = ListItem(List=reverse(rec_2), Index=0, Wrap=True)  # -> flatten(Item)
flatten = FlattenTree(Tree=stack_2, Path=item_9)
merge_9 = Merge(Data1=clean, Data2=flatten)
stack_8 = CreateStack(UIElements=merge_9, Horizontal=False)

# ----
# highlight selected viewpoint in 2d
cull_i = CullIndex(List=listdexs, Indices=mindex_6.Index, Wrap=True)
branch = TreeBranch(Tree=merge_9, Path=mindex_6.Index, MaintainPaths=True)
branch_2 = TreeBranch(Tree=merge_9, Path=cull_i, MaintainPaths=True)
adjustelem_2 = AdjustElementAppearance(ElementsToAdjust=branch, Background=RGB(246, 255, 82))
adjustelem_3 = AdjustElementAppearance(ElementsToAdjust=branch_2, Background=RGB(255, 255, 255))

# ----
# average color for each viewpoint
bmp = LoadImage(FilePath=panel_10)
scale = ScaleImage(Image=bmp, Mode=0, Scale="0.05")  # -> Image, Filter
values_9 = ImageValues(Image=scale.Image, Modes=0)
avr = Average(Input=values_9)  # -> flatten(ArithmeticMean)
col_2 = Colour(avr)
panel_12 = Panel(col_2)

# ----
# assign preview colors
col_3 = Colour(col_2)
previewmat = CustomPreviewMaterials(Geometry=id, DiffuseColor=col_3)

# ----
# Generate Lens
panel_13 = Panel("-0.5")

observation_angle_degrees = Number(131)

diameter = Number(2)
division = Division(A=diameter, B=2)

# ----
# instant quadmesh
selobj_3 = ObjectsBySelection(Reset=values_3.Values, LiveMode=False)
# Fabricate Lenses
panel_14 = Panel("C:\Users\yunyizhu\Desktop\tmp_out.obj")
panel_15 = Panel("C:\Users\yunyizhu\Desktop\tmp.obj")
id_4 = Guid(selobj_3)
python_2 = GhPythonScript(mesh=id_4, start=Toggle(True), temp_filepath=panel_15, diameter=diameter)  # -> out, faces, flag
# ---------- python_2: Python ----------
__author__ = "junyiz"
__version__ = "2019.03.04"

import rhinoscriptsyntax as rs
import ghpythonlib.components as ghcomp
import Rhino
import scriptcontext as sc
import System
import clr

sc.doc = Rhino.RhinoDoc.ActiveDoc
flag = False
#Choose OBJ option ( Geometry=Mesh  EndOfLine=CRLF  ExportRhinoObjectNames=ExportObjectsAsOBJObjects  ExportRhinoGroupOrLayerNames=DoNotExportGroupNames  ExportMaterialDefinitions=Yes  ChangeWhitespaceToUnderscores=Yes  YUp=Yes  WrapLongLines=Yes  WritePrecision=17  ExportMeshTextureCoordinates=Yes  ExportMeshVertexNormals=Yes  ExportMeshVertexColors=Yes  ExportOpenMeshes=No  VertexWelding=Welded  CreateNGons=No ): _Enter

if start == True and mesh is not None:
    surfaceArea = rs.Area(mesh)
    print(surfaceArea)
    faces = (surfaceArea/(diameter*diameter)) * 2.3
    print(faces)
    filePath = temp_filepath
    rs.Command('_-Export ' + filePath + ' _Enter' + ' _Enter')
#    rs.Command('_Hide')
    flag = True

sc.doc = ghdoc
# ---------- end python_2 ----------
python_3 = GhPythonScript(
    faces=python_2.faces,
    start=python_2.flag,
    temp_filepath=panel_15,
    instantmesh_path="C:\Users\yunyizhu\Desktop\InstantMeshes.exe",
    temp_out_filepath=panel_14)  # -> out, flag
# ---------- python_3: Python ----------
__author__ = "tianyec"
__version__ = "2019.03.16"

import rhinoscriptsyntax as rs
import subprocess as sp
import shutil
import time
import os

flag = False
exists = os.path.isfile(temp_filepath)
print(exists)

if start and exists and faces > 0:
    instantMeshPath = instantmesh_path
    tmpFilePath = temp_filepath
    tmpOutFilePath = temp_out_filepath
    face_input = "--faces " + str(int(faces))
    print(face_input)
    other_input = "-p 6 -r 6 -e"
#    other_input = ""
    #tmpOutFilePath = tmpOutFilePath + face_input
    sp.call([instantMeshPath, tmpFilePath, "-o", tmpOutFilePath, "-f", str(int(faces)), "-p", "6", "-r", "6"])
    print([instantMeshPath, tmpFilePath, "-o", tmpOutFilePath, face_input, other_input])
    flag = True
# ---------- end python_3 ----------
python_4 = GhPythonScript(filepath=panel_14, start=python_3.flag)  # -> out, flag
# ---------- python_4: Python ----------
__author__ = "tianyec"
__version__ = "2019.03.16"

import rhinoscriptsyntax as rs
import ghpythonlib.components as ghcomp
import Rhino
import scriptcontext as sc
import System
import clr
sc.doc = Rhino.RhinoDoc.ActiveDoc

flag = False
if start == True:
    filePath = filepath
    rs.Command('_-SelNone ')
    rs.Command('_-Import ' + filePath + ' _Enter')
    flag = True
#elif rs.Area(mesh) is not None:
#    flag = True
    
sc.doc = ghdoc
# ---------- end python_4 ----------
selobj_4 = ObjectsBySelection(Reset=python_4.flag, LiveMode=False)
mesh_2 = Mesh(selobj_4)
demesh = DeconstructMesh(Mesh=mesh_2)  # -> Vertices, Faces, Colours, Normals
bool = Boolean(mesh_2)
cset_2 = CreateSet(List=demesh.Vertices)  # -> Set, Map
python_5 = GhPythonScript(start=bool)  # -> out, flag
# ---------- python_5: Python ----------
__author__ = "tianyec"
__version__ = "2019.03.16"

import rhinoscriptsyntax as rs
import ghpythonlib.components as ghcomp
import Rhino
import scriptcontext as sc
import System
import clr
sc.doc = Rhino.RhinoDoc.ActiveDoc

flag = False
if start == True:
    rs.Command('_-Hide  _Enter')
    flag = True
#elif rs.Area(mesh) is not None:
#    flag = True
    
sc.doc = ghdoc
# ---------- end python_5 ----------
pt = Point(cset_2.Set)

observation_angle_half_radians = Number(expr("x/2 * Pi / 180", observation_angle_degrees))
can_see_angle = Number(1.570796327)

# ----
# debug tool: compare two large branches
panel_16 = Panel("{1;207}")
data = Data()
branch_3 = TreeBranch(Tree=data, Path="{0;207}", MaintainPaths=True)
branch_4 = TreeBranch(Tree=data, Path=panel_16, MaintainPaths=True)
equals = Equality(FirstNumber=branch_3, SecondNumber=branch_4)  # -> Equality, Inequality
panel_17 = Panel(equals.Equality)

# ----
# new viewpoint
panel_18 = Panel("New Viewpoint")
button_7 = CreateButton(ButtonName=panel_18, ButtonStyle=0)
values_10 = ValueListener(Elements=button_7, SomeProperty=True)  # -> Values, Indices

merge_10 = Merge(Data1=button_7, Data2=stack_8)  # -> flatten(Result)
stack_9 = CreateStack(UIElements=merge_10, Horizontal=False)

merge_11 = Merge(Data1=mdv, Data3=stack_9, Data4=separator)
merge_12 = Merge(Data1=flatten(merge_3), Data2=flatten(merge_11), Data3=flatten(merge_6), Data4=flatten(merge_7))
addelems = AddElements(Window=launchwin, Elements=flatten(merge_12), DoVLChecking=True)  # -> AddedElements, ElementNames

# ----
# camera point at model center
timer_2 = Timer(TimerInterval=500, Target=python_8)

# ----
# find out which viewing range camera is in
timer_3 = Timer(TimerInterval=200, Target=viewports)
viewports = ViewportProperties(Update=True, AutoUpdate=True)  # -> ViewportNames, ActiveViewportIndex, ViewportBounds, ViewportDisplayMode, CameraLocation, CameraTarget, CameraPlane, CameraLensLength, CameraProjection, CameraUp
mindex_8 = MemberIndex(Set=viewports.ViewportNames, Member="Perspective")  # -> Index, Count
item_10 = ListItem(List=viewports.CameraLocation, Index=mindex_8.Index, Wrap=True)
camera_location = Point(item_10)
material_filepath = Text(item_8)

# ----
# Selected Object
panel_19 = Panel("C:\Users\yunyizhu\Desktop\canvas.png")
mesh_3 = Mesh(selobj)

# ----
# Selected Object Center
center_3 = Center(Geometry=mesh_3)  # -> Center, Dimension

python_6 = GhPythonScript(fileName="C:\Users\yunyizhu\Desktop\models\camera\camera.obj", start=values_10.Values, model_center=center_3.Center)  # -> out, resetSelection; inputs model_center: Point3d
# ---------- python_6: Python ----------
__author__ = "yunyizhu"
__version__ = "2020.07.09"
        
        
import scriptcontext as sc
import rhinoscriptsyntax as rs
import Rhino
from scriptcontext import doc
import rhinoscriptsyntax as rs
        
resetSelection = False
loc_move = Rhino.Geometry.Vector3d(0,0,10);
viewpoint_loc = Rhino.Geometry.Point3d.Add(model_center, loc_move)
        
if start and (viewpoint_loc is not None) and (viewpoint_loc != Rhino.Geometry.Point3d(0,0,0)):
    sc.doc = Rhino.RhinoDoc.ActiveDoc
    
    rs.Command("_-Import " + fileName + " _Enter _Enter")
    
    ids = rs.SelectedObjects()
#    rs.ScaleObjects(ids, Rhino.Geometry.Point3d(0,0,0), [5,5,5])
    rs.MoveObjects(ids, Rhino.Geometry.Vector3d(viewpoint_loc))
    
    sc.doc = ghdoc
# ---------- end python_6 ----------

# ----
# obj center
pt_2 = Point(center_3.Center)

# ----
# Convert Lens Point to UV Coordinates
lens_centers_raw_values = Point(pt)
object_mesh = Mesh(mesh_3)
meshcp = MeshClosestPoint(Point=lens_centers_raw_values, Mesh=object_mesh)  # -> Point, Index, Parameter
dist = Distance(PointA=lens_centers_raw_values, PointB=meshcp.Point)
smaller = SmallerThan(FirstNumber=dist, SecondNumber=0.2)  # -> SmallerThan, OrEqualTo
true_4 = Boolean(True)
mindex_9 = MemberIndex(Set=smaller.SmallerThan, Member=true_4)  # -> Index, Count
item_11 = ListItem(List=meshcp.Point, Index=mindex_9.Index, Wrap=True)
item_12 = ListItem(List=meshcp.Parameter, Index=mindex_9.Index, Wrap=True)
python_7 = GhPythonScript(mesh=object_mesh, barycentrics=item_12)  # -> out, uv_coords; inputs mesh: Mesh, barycentrics: list
# ---------- python_7: Python ----------
__author__ = "yunyizhu"
__version__ = "2020.07.12"

import rhinoscriptsyntax as rs
import Rhino.Geometry
import re

coords = mesh.TextureCoordinates
faces = mesh.Faces

uv_coords = []

def parseBarycentric(barycentric):
    return re.split('\[|\]|;', barycentric)[:-1]

for i in range(len(barycentrics)):
    barycentric = parseBarycentric(barycentrics[i])
    face_index = int(barycentric[0])
    face = faces[face_index]
    
    coord_A = coords[face.A]
    coord_B = coords[face.B]
    coord_C = coords[face.C]
    coord_D = coords[face.D]
    
    final_coord_x = coord_A[0] * float(barycentric[1]) + coord_B[0] * float(barycentric[2]) + \
                    coord_C[0] * float(barycentric[3]) + coord_D[0] * float(barycentric[4])
    final_coord_y = coord_A[1] * float(barycentric[1]) + coord_B[1] * float(barycentric[2]) + \
                    coord_C[1] * float(barycentric[3]) + coord_D[1] * float(barycentric[4])
    
    # 1-y instead of y because 
    # bitmap write in the opposite direction
    uv_coords.append(Rhino.Geometry.Point3d(final_coord_x, 1-final_coord_y, 0))
    
    
#for c in coords:
#    uv_coords.append((c[0], c[1]))
# ---------- end python_7 ----------
meval = MeshEval(Mesh=object_mesh, Parameter=item_12)  # -> Point, Normal, Colour
# lens uv coords
pt_3 = Point(item_11)

# ----
# bake object
panel_20 = Panel("object_material")

# ----
# orient camera
center_4 = Center(Geometry=id)  # -> Center, Dimension
true_5 = Boolean(True)
mindex_10 = MemberIndex(Set=values_7.Values, Member=true_5)  # -> flatten(Index), Count

# ----
# viewpoints
pt_4 = Point(center_4.Center)

python_8 = GhPythonScript(
    camera_ids=id,
    camera_centers=pt_4,
    camera_lens_centers=center.Center,
    camera_side_anchors=center_2.Center,
    model_center=center_3.Center)  # -> out, resetSelection; inputs camera_ids: list of Guid, camera_centers: list of Point3d, camera_lens_centers: list of Point3d, camera_side_anchors: list of Point3d, model_center: Point3d
# ---------- python_8: Python ----------
__author__ = "yunyizhu"
__version__ = "2020.07.09"
        
        
import scriptcontext as sc
import rhinoscriptsyntax as rs
import Rhino
from scriptcontext import doc
import rhinoscriptsyntax as rs
        
resetSelection = False
eps = 0.05

def same_line(point1, point2, point3):
    vec1 = Rhino.Geometry.Point3d.Subtract(point1, point2)
    vec1.Unitize()
    vec2 = Rhino.Geometry.Point3d.Subtract(point1, point3)
    vec2.Unitize()
    return vec1.EpsilonEquals(vec2, eps) or vec1.EpsilonEquals(-vec2, eps)

        
if True:
    sc.doc = Rhino.RhinoDoc.ActiveDoc
    
    for i in range(len(camera_ids)):
        id = camera_ids[i]
        camera_center = camera_centers[i]
        lens_center = camera_lens_centers[i]
        side_anchor = camera_side_anchors[i]
        
        if not (same_line(camera_center, lens_center, model_center)):
            towards_vec = Rhino.Geometry.Point3d.Subtract(model_center, camera_center)
            world_z = Rhino.Geometry.Vector3d.ZAxis
            side_vec = Rhino.Geometry.Vector3d.CrossProduct(towards_vec, world_z)
            side_target = Rhino.Geometry.Point3d.Add(camera_center, side_vec)
            
            sources = [camera_center, lens_center, side_anchor]
            targets = [camera_center, model_center, side_target]
            rs.OrientObject(id, sources, targets)
    
    sc.doc = ghdoc
# ---------- end python_8 ----------

item_13 = ListItem(List=pt_4, Index=mindex_10.Index, Wrap=True)
vec2pt = Vector2Pt(PointA=pt_2, PointB=item_13, Unitize=False)  # -> unitize(Vector), Length
subtraction = Subtraction(A=vec2pt.Length, B="15")
multiplication = Multiplication(A=vec2pt.Vector, B=subtraction)
move = Move(Geometry=pt_2, Motion=multiplication)  # -> Geometry, Transform
mod_viewport = ModifyViewport(CameraLocation=move.Geometry, CameraTarget=pt_2, AnimateRestore=False, RestoreFrames=10)

viewpoint_locations = Point(pt_4)
object_center = Point(pt_2)
vec2pt_2 = Vector2Pt(PointA=object_center, PointB=camera_location, Unitize=False)  # -> Vector, Length
vec2pt_3 = Vector2Pt(PointA=object_center, PointB=viewpoint_locations, Unitize=False)  # -> Vector, Length
angle = Angle(VectorA=vec2pt_2.Vector, VectorB=vec2pt_3.Vector)  # -> Angle, Reflex
sort_2 = SortList(Keys=angle.Angle)  # -> Keys, ValuesA
item_14 = ListItem(List=sort_2.Keys, Index=0, Wrap=True)
mindex_11 = MemberIndex(Set=angle.Angle, Member=item_14)  # -> Index, Count
item_15 = ListItem(List=material_filepath, Index=mindex_11.Index, Wrap=True)

filter_4 = StreamFilter(Gate=values_3.Values, Stream0=item_15, Stream1=panel_19)
panel_21 = Panel(filter_4)

materials = CreateModifyMaterials(Name=panel_20, DiffuseBitmap=filter_4)
attributes = DefineObjectAttributes(Layer="center_lenticle_object", Material=materials)
bake = BakeObjects(Geometry=mesh_3, Attributes=attributes, BakeName="lenticular_object", Bake=values_4.Values)

previewmat_2 = CustomPreviewMaterials(Geometry=mesh_3, DiffuseBitmap=filter_4)

object_center_2 = Point(center_3.Center)
viewpoint_centers = Point(pt_4)
lens_centers = Point(pt_3)
lens_normals = Vector(meval.Normal)
object_mesh_2 = Mesh(mesh_3)

pl = PlaneNormal(Origin=lens_centers, ZAxis=lens_normals)
lens_planes = Plane(pl)

deplane = DeconstructPlane(Plane=lens_planes)  # -> Origin, XAxis, YAxis, ZAxis

# ----
# anchor at (1,1,0)
move_2 = Move(Geometry=deplane.Origin, Motion=expr("0.5*x", deplane.XAxis))  # -> Geometry, Transform
pt_5 = Point(move_2.Geometry)

# ----
# find angle to rotate x-axis
meshcp_2 = MeshClosestPoint(Point=pt_5, Mesh=object_mesh_2)  # -> Point, Index, Parameter
python_9 = GhPythonScript(mesh=object_mesh_2, barycentrics=meshcp_2.Parameter)  # -> out, uv_coords; inputs mesh: Mesh, barycentrics: list; same code as python_7
vec2pt_4 = Vector2Pt(PointA=python_7.uv_coords, PointB=python_9.uv_coords, Unitize=False)  # -> unitize(Vector), Length
python_10 = GhPythonScript(direction=vec2pt_4.Vector)  # -> out, flatten(angle); inputs direction: Vector3d
# ---------- python_10: Python ----------
__author__ = "yunyizhu"
__version__ = "2020.07.16"

import rhinoscriptsyntax as rs
import math

angle = math.atan2(direction.Y, direction.X)
# ---------- end python_10 ----------

lens_planes_2 = Plane(lens_planes)
lens_centers_2 = Point(pt_3)
radius = Number(division)
angles = Number(python_10.angle)
mesh_4 = Mesh(object_mesh_2)

lens_centers_3 = Point(pt_3)
lens_center_normals = Vector(meval.Normal)
radius_2 = Number(radius)
mesh_5 = Mesh(mesh_4)

multiplication_2 = Multiplication(A=radius_2, B="0.95")
multiplication_3 = Multiplication(A=radius_2, B=panel_13)
multiplication_4 = Multiplication(A=lens_center_normals, B=multiplication_2)
multiplication_5 = Multiplication(A=lens_center_normals, B=multiplication_3)
move_3 = Move(Geometry=lens_centers_3, Motion=multiplication_4)  # -> Geometry, Transform
move_4 = Move(Geometry=lens_centers_3, Motion=multiplication_5)  # -> Geometry, Transform
ln = Line(StartPoint=move_4.Geometry, EndPoint=move_3.Geometry)
mpipe = MeshPipe(Curve=ln, Radius=radius_2, Accuracy=0.2, Rotation=0, Segments=10, Caps=2)

# ----
# show the lens
filter_5 = StreamFilter(Gate=Toggle(False), Stream1=mpipe)
previewmat_3 = CustomPreviewMaterials(Geometry=filter_5, DiffuseColor=RGB(255, 255, 255), Transparency="0.5")

rec_3 = DataRecorder(values_4.Values, DataLimit=-10, RecordData=True)
lng_3 = ListLength(List=rec_3)
larger_3 = LargerThan(FirstNumber=lng_3, SecondNumber="1")  # -> LargerThan, OrEqualTo
filter_6 = StreamFilter(Gate=larger_3.LargerThan, Stream1=mpipe)

mdif = MeshDifference(MeshesA=graft(filter_6), MeshesB=mesh_5)
mshclsd = IsMeshClosed(Mesh=mdif)
mindex_12 = MemberIndex(Set=flatten(mshclsd), Member=Toggle(True))  # -> flatten(Index), Count
item_16 = ListItem(List=flatten(mdif), Index=mindex_12.Index, Wrap=True)  # -> flatten(Item)
mesh_6 = Mesh(item_16)

intersect_uv = Point(simplify(graft([Point(0, 0, 0), Point(0, 0.9, 0), Point(0.9, 0, 0), Point(0, -0.9, 0), Point(-0.9, 0, 0), Point(0.707, 0.707, 0), Point(0.707, -0.707, 0), Point(-0.707, 0.707, 0), Point(-0.707, -0.707, 0), Point(0, 0.5, 0), Point(0.5, 0, 0), Point(0, -0.5, 0), Point(-0.5, 0, 0), Point(0.2, 0, 0), Point(0, 0.2, 0), Point(-0.2, 0, 0), Point(-0.2, 0, 0), Point(0.15, 0.15, 0), Point(0.15, -0.15, 0), Point(-0.15, 0.15, 0), Point(-0.15, -0.15, 0)])))
substrate_height = Number(0.95)
radius_3 = Number(radius)

# ----
# incident point according to uv
python_11 = GhPythonScript(r=radius_3, intersect_uv=intersect_uv)  # -> out, simplify(height); inputs intersect_uv: Point3d
# ---------- python_11: Python ----------
__author__ = "yunyizhu"
__version__ = "2020.09.01"

import rhinoscriptsyntax as rs
import math

height = math.sqrt(r*r - intersect_uv.X**2 - intersect_uv.Y**2)
# ---------- end python_11 ----------
deplane_2 = DeconstructPlane(Plane=pl)  # -> Origin, XAxis, YAxis, ZAxis
pdecon = Deconstruct(Point=intersect_uv)  # -> XComponent, YComponent, ZComponent
thickness_add = Number(python_11.height)
X = Number(pdecon.XComponent)
Y = Number(pdecon.YComponent)
multiplication_6 = Multiplication(A=deplane_2.YAxis, B=Y)
multiplication_7 = Multiplication(A=deplane_2.XAxis, B=X)
addition_2 = Addition(A=substrate_height, B=thickness_add)
addition_3 = Addition(A=multiplication_7, B=multiplication_6)
Z = Number(addition_2)
multiplication_8 = Multiplication(A=Z, B=deplane_2.ZAxis)
addition_4 = Addition(A=addition_3, B=multiplication_8)
move_5 = Move(Geometry=deplane_2.Origin, Motion=addition_4)  # -> simplify(Geometry), Transform
indicent_point = Point(move_5.Geometry)

# ----
# topper center of lens
multiplication_9 = Multiplication(A=lens_normals, B=substrate_height)
move_6 = Move(Geometry=lens_centers, Motion=multiplication_9)  # -> Geometry, Transform
upper_lens_centers = Point(move_6.Geometry)

# ----
# bake the lenses
panel_22 = Panel("glass")
attributes_2 = DefineObjectAttributes(Layer="lenses", Material=panel_22)
bake_2 = BakeObjects(Geometry=mesh_6, Attributes=attributes_2, BakeName="lenses", Bake=values_4.Values)

lng_4 = ListLength(List=flatten(intersect_uv))
dup = DuplicateData(Data=upper_lens_centers, Number=lng_4, Order=True)
partition = PartitionList(List=dup, Size=lng_4)  # -> simplify(Chunks)

pl_3pt = Plane3Pt(PointA=simplify(graft(indicent_point)), PointB=simplify(graft(partition)), PointC=viewpoint_centers)
ray_lens_planes = Plane(pl_3pt)
cp = PlaneClosestPoint(Point=flatten(viewpoint_centers), Plane=ray_lens_planes)  # -> simplify(Point), simplify(UVPoint), Distance
pt_6 = Point(cp.UVPoint)

# ----
# indicent angle smaller than observation
X_2 = UnitX(Factor=1)
vec = Vector(pt_6)
angle_2 = Angle(VectorA=vec, VectorB=expr("-x", X_2))  # -> Angle, Reflex
incident_angles = Number(angle_2.Angle)
smaller_2 = SmallerThan(FirstNumber=incident_angles, SecondNumber=can_see_angle)  # -> SmallerThan, OrEqualTo
false = Boolean(False)
mindex_13 = MemberIndex(Set=smaller_2.OrEqualTo, Member=false)  # -> simplify(Index), Count

# ----
# refracted angle
refractive_index_1_52 = Number(1.52)
sin = Sine(Value=incident_angles)
division_2 = Division(A=sin, B=refractive_index_1_52)
asin = ArcSine(Value=division_2)
refracted_angles = Number(asin)

# ----
# uv of refracted angle
X_3 = UnitX(Factor=1)
rotate = Rotate(Geometry=X_3, Angle=expr("-x", refracted_angles), Plane=PlaneXY(0, 0, 0))  # -> Geometry, Transform

# ----
# data align
lng_5 = ListLength(List=flatten(intersect_uv))
dup_2 = DuplicateData(Data=lens_planes, Number=lng_5, Order=True)
partition_2 = PartitionList(List=dup_2, Size=lng_5)  # -> simplify(Chunks)

# ----
# World XYZ of refracted points
deplane_3 = DeconstructPlane(Plane=ray_lens_planes)  # -> Origin, XAxis, YAxis, ZAxis
pdecon_2 = Deconstruct(Point=rotate.Geometry)  # -> XComponent, YComponent, ZComponent
multiplication_10 = Multiplication(A=pdecon_2.XComponent, B=deplane_3.XAxis)
multiplication_11 = Multiplication(A=pdecon_2.YComponent, B=deplane_3.YAxis)
multiplication_12 = Multiplication(A=pdecon_2.ZComponent, B=deplane_3.ZAxis)
addition_5 = Addition(A=multiplication_10, B=multiplication_11)
addition_6 = Addition(A=addition_5, B=multiplication_12)
line = LineSDL(Start=deplane_3.Origin, Direction=addition_6, Length=4)
plx = LinePlane(Line=line, Plane=simplify(graft(partition_2)))  # -> Point, ParamL, ParamP
pt_7 = Point(plx.Point)
color_pattern_uv = Point(plx.ParamP)

# ----
# filter incident angle
replace = ReplaceItems(List=color_pattern_uv, Indices=mindex_13.Index, Wrap=False)  # -> simplify(List)

# ----
# data align
lng_6 = ListLength(List=flatten(intersect_uv))
dup_3 = DuplicateData(Data=python_10.angle, Number=lng_6, Order=True)
partition_3 = PartitionList(List=dup_3, Size=lng_6)  # -> simplify(Chunks)

replace_2 = ReplaceItems(Indices=mindex_13.Index, Wrap=False)

# ----
# Calc UV Radius
deplane_4 = DeconstructPlane(Plane=lens_planes_2)  # -> Origin, XAxis, YAxis, ZAxis
meshcp_3 = MeshClosestPoint(Point=lens_centers_2, Mesh=mesh_4)  # -> Point, Index, Parameter
line_2 = LineSDL(Start=deplane_4.Origin, Direction=deplane_4.ZAxis, Length=1)

multiplication_13 = Multiplication(A=deplane_4.XAxis, B=radius)

move_7 = Move(Geometry=deplane_4.Origin, Motion=multiplication_13)  # -> Geometry, Transform
rotax = RotateAxis(Geometry=move_7.Geometry, Angle=angles, Axis=line_2)  # -> Geometry, Transform
pt_8 = Point(rotax.Geometry)
meshcp_4 = MeshClosestPoint(Point=pt_8, Mesh=mesh_4)  # -> Point, Index, Parameter
python_12 = GhPythonScript(mesh=mesh_4, params_orig=meshcp_3.Parameter, params_moved=meshcp_4.Parameter)  # -> out, uv_radius; inputs mesh: Mesh
# ---------- python_12: Python ----------
__author__ = "yunyizhu"
__version__ = "2020.07.12"

import rhinoscriptsyntax as rs
import Rhino.Geometry
import re
import math

coords = mesh.TextureCoordinates
faces = mesh.Faces

uv_coords = []

def parseBarycentric(barycentric):
    return re.split('\[|\]|;', barycentric)[:-1]
    
def uvDistance(uv_1, uv_2):
    return math.sqrt((uv_2[0] - uv_1[0])**2 + (uv_2[1] - uv_1[1])**2)

def paramsToUV(params):
    barycentric = parseBarycentric(params)
    face_index = int(barycentric[0])
    face = faces[face_index]
    
    coord_A = coords[face.A]
    coord_B = coords[face.B]
    coord_C = coords[face.C]
    coord_D = coords[face.D]
    
    final_coord_x = coord_A[0] * float(barycentric[1]) + coord_B[0] * float(barycentric[2]) + \
                    coord_C[0] * float(barycentric[3]) + coord_D[0] * float(barycentric[4])
    final_coord_y = coord_A[1] * float(barycentric[1]) + coord_B[1] * float(barycentric[2]) + \
                    coord_C[1] * float(barycentric[3]) + coord_D[1] * float(barycentric[4])
    
    # 1-y instead of y because 
    # bitmap write in the opposite direction
    return (final_coord_x, 1-final_coord_y)

uv_orig = paramsToUV(params_orig)
uv_moved = paramsToUV(params_moved)
distance = uvDistance(uv_orig, uv_moved)
if (distance > 0.1):
    distance = 0
uv_radius = distance
# ---------- end python_12 ----------

panel_23 = Panel(panel_10)
panel_24 = Panel(panel_19)
lng_7 = ListLength(List=flatten(intersect_uv))

c_script = CSharpScript(file_to_clear=panel_24, start=Button())  # -> out; inputs file_to_clear: String, start: Boolean
# ---------- c_script: C# usings ----------
using System.Drawing;
# ---------- c_script: C# ----------
    if (start) {
      Bitmap clear = new Bitmap(1200, 1200);

      if(System.IO.File.Exists(file_to_clear))
        System.IO.File.Delete(file_to_clear);
      clear.Save(file_to_clear, System.Drawing.Imaging.ImageFormat.Png);
    }
# ---------- end c_script ----------
panel_25 = Panel(c_script)

# ----
# filter out ones don't hit color plane
origin = Point(Point(0, 0, 0))
dist_2 = Distance(PointA=replace, PointB=origin)
larger_4 = LargerThan(FirstNumber=dist_2, SecondNumber=radius)  # -> LargerThan, OrEqualTo
true_6 = Boolean(True)
mindex_14 = MemberIndex(Set=larger_4.LargerThan, Member=true_6)  # -> simplify(Index), Count
replace_3 = ReplaceItems(List=replace, Indices=mindex_14.Index, Wrap=False)  # -> simplify(List)

python_13 = GhPythonScript(distance=dist_2, point=replace, r=radius_3)  # -> out, reflected_point, double_reflected_point; inputs point: Point3d
# ---------- python_13: Python ----------
__author__ = "yunyizhu"
__version__ = "2020.09.02"

import rhinoscriptsyntax as rs
import Rhino

if (distance > r):
    reflected_point = None
    reflected_distance = (distance - r) % (4*r)
    if (reflected_distance <= 2*r):
        reflected_distance = r - reflected_distance
    else:
        reflected_distance = reflected_distance - 3*r
    double_reflected_point = Rhino.Geometry.Point3d.Multiply(reflected_distance/distance, point)
else:
    double_reflected_point = None
    reflected_point = point
# ---------- end python_13 ----------
color_pattern_double_reflected = Point(python_13.double_reflected_point)

# ----
# uv coordinates
pt_9 = Point(color_pattern_double_reflected)

# ----
# Mirror across X-axis
pdecon_3 = Deconstruct(Point=pt_9)  # -> XComponent, YComponent, ZComponent
neg = Negative(Value=pdecon_3.YComponent)
pt_10 = ConstructPoint(XCoordinate=pdecon_3.XComponent, YCoordinate=neg, ZCoordinate=0)  # -> simplify(Point)

# ----
# Rotate UV towards Anchor
rotate_2 = Rotate(Geometry=pt_10, Angle=graft(partition_3), Plane=PlaneXY(0, 0, 0))  # -> simplify(Geometry), Transform

color_pattern_uv_filtered = Point(python_13.reflected_point)

# ----
# uv coordinates
pt_11 = Point(color_pattern_uv_filtered)

# ----
# Mirror across X-axis
pdecon_4 = Deconstruct(Point=pt_11)  # -> XComponent, YComponent, ZComponent
neg_2 = Negative(Value=pdecon_4.YComponent)
pt_12 = ConstructPoint(XCoordinate=pdecon_4.XComponent, YCoordinate=neg_2, ZCoordinate=0)  # -> simplify(Point)

# ----
# Rotate UV towards Anchor
rotate_3 = Rotate(Geometry=pt_12, Angle=graft(partition_3), Plane=PlaneXY(0, 0, 0))  # -> simplify(Geometry), Transform

pt_13 = Point(rotate_2.Geometry)
pt_14 = Point(rotate_3.Geometry)

c_script_2 = CSharpScript(
    canvas_path=panel_24,
    viewpoint_material_source_paths=panel_23,
    lens_uv_coords=python_7.uv_coords,
    color_pixel_uv_coords=pt_14,
    color_pixel_double_reflected=pt_13,
    sample_ray_number=lng_7,
    uv_radius=python_12.uv_radius)  # -> out; inputs canvas_path: String, viewpoint_material_source_paths: list of String, lens_uv_coords: list of Point3d, color_pixel_uv_coords: tree of Point3d, color_pixel_double_reflected: tree of Point3d, sample_ray_number: Int32, uv_radius: list of Double
# ---------- c_script_2: C# ----------
    // Create canvas and source bitmaps
    Bitmap canvas = new Bitmap(LENGTH, LENGTH);
    List<Bitmap> sources = new List<Bitmap>();
    foreach (string path in viewpoint_material_source_paths) {
      Bitmap source_original = (Bitmap) Bitmap.FromFile(path);
      sources.Add(new Bitmap(source_original, new Size(LENGTH, LENGTH)));
    }

    // Calculate constants, clean data
    List < int> radiuses = new List<int> {};
    for (int i = 0; i < lens_uv_coords.Count; i++) {
      radiuses.Add((int) Math.Floor(LENGTH * uv_radius[i]));
    }
    SAMPLE_RAY_NUMBER = sample_ray_number;

    // Prepare material averaged color for each lens
    List < List < Color >> lens_colors = new List < List < Color >> {};
    for (int i = 0; i < lens_uv_coords.Count; i++) {
      // init a new list for the lens
      List < Color > one_lens_colors = new List<Color>{};

      // pixel location for the lens
      Point3d lens_uv = lens_uv_coords[i];
      int[] location_on_pic = {(int) Math.Floor(lens_uv.X * LENGTH), (int) Math.Floor(lens_uv.Y * LENGTH)};
      for (int j = 0; j < sources.Count; j++) {
        Color averaged = averageColorCircle(sources[j], radiuses[i], location_on_pic);
        one_lens_colors.Add(averaged);
      }
      lens_colors.Add(one_lens_colors);
    }


    // traverse through the lenses
    for (int i = 0; i < lens_uv_coords.Count; i++) {
      // pixel location of this lens
      Point3d lens_uv = lens_uv_coords[i];
      int[] location_on_pic = {(int) Math.Floor(lens_uv.X * LENGTH), (int) Math.Floor(lens_uv.Y * LENGTH)};

      List <List< Point3d >> color_pixel_placements = new List<List<Point3d>> {};
      List <List< Point3d >> secondary_color_pixel_placements = new List<List<Point3d>> {};
      List < Color > colors = lens_colors[i];

      for (int j = 0; j < sample_ray_number; j++) {
        GH_Path path = new GH_Path(j, i);
        color_pixel_placements.Add(color_pixel_uv_coords.Branch(path));
        secondary_color_pixel_placements.Add(color_pixel_double_reflected.Branch(path));
      }
      drawSectionCirle(canvas, colors, color_pixel_placements, secondary_color_pixel_placements, location_on_pic, radiuses[i]);
    }

    // Draw the bitmap onto the canvas path
    if(System.IO.File.Exists(canvas_path))
      System.IO.File.Delete(canvas_path);
    canvas.Save(canvas_path, System.Drawing.Imaging.ImageFormat.Png);
# ---------- c_script_2: C# additional code ----------
  public static readonly char[] UV_DELIMS = {'(',',',')'};
  public static readonly char[] FACE_DELIMS = {'(',',',')'};
  public static readonly int LENGTH = 4096; // material must be square, length = width = height
  public static int SAMPLE_RAY_NUMBER;
  public static readonly double SECONDARY_DEBUFF = 10;

  // section a circle
  public static void drawSectionCirle(Bitmap canvas, List<Color> colors,
    List<List<Point3d>> color_pixel_placements, List<List<Point3d>> secondary_color_pixel_placements,
  int[] lens_center_location, int radius) {
    for (int i = -radius; i < radius; i++) {
      int j_limit = (int) Math.Floor(Math.Sqrt(radius * radius - i * i));
      for (int j = -j_limit; j < j_limit; j++) {
        double min_distance_sq = double.PositiveInfinity;
        int closest_color_index = -1;

        // traverse primary points
        for(int k = 0; k < colors.Count; k++) {
          for (int ray_i = 0; ray_i < SAMPLE_RAY_NUMBER; ray_i++) {
            Point3d color_location = color_pixel_placements[ray_i][k];
            if (color_location.X == 0 && color_location.Y == 0 && color_location.Z == 0) {
              // null are translated to (0,0,0)
              continue;
            }
            double distance_sq = (double) Math.Pow(color_location.X * radius - i, 2)
              + Math.Pow(color_location.Y * radius - j, 2);
            if (distance_sq < min_distance_sq) {
              min_distance_sq = distance_sq;
              closest_color_index = k;
            }
          }
        }

        //        traverse secondary points with debuff
        for(int k = 0; k < colors.Count; k++) {
          for (int ray_i = 0; ray_i < SAMPLE_RAY_NUMBER; ray_i++) {
            Point3d color_location = secondary_color_pixel_placements[ray_i][k];
            if (color_location.X == 0 && color_location.Y == 0 && color_location.Z == 0) {
              // null are translated to (0,0,0)
              continue;
            }
            double distance_sq = (double) Math.Pow(color_location.X * radius - i, 2)
              + Math.Pow(color_location.Y * radius - j, 2);
            if (distance_sq * SECONDARY_DEBUFF < min_distance_sq) {
              min_distance_sq = distance_sq * SECONDARY_DEBUFF;
              closest_color_index = k;
            }
          }
        }

        if (closest_color_index != -1) {
          try {
            canvas.SetPixel(lens_center_location[0] + i, lens_center_location[1] + j, colors[closest_color_index]);
          } catch {}
        }
      }
    }
  }

  // fill a naive circle
  public static void drawCircle(Bitmap canvas, Bitmap source, int radius, int[] location) {
    for (int i = -radius; i < radius; i++) {
      int j_limit = (int) Math.Floor(Math.Sqrt(radius * radius - i * i));
      for (int j = -j_limit; j < j_limit; j++) {
        try {
          Color color = source.GetPixel(location[0] + i, location[1] + j);
          canvas.SetPixel(location[0] + i, location[1] + j, color);
        } catch {}
      }
    }
  }

  // average color for the area underneath a lens
  public static Color averageColorCircle(Bitmap source, int radius, int[] location) {
    int r = 0;
    int g = 0;
    int b = 0;

    int total = 0;

    for (int i = -radius; i < radius; i++) {
      int j_limit = (int) Math.Floor(Math.Sqrt(radius * radius - i * i));
      for (int j = -j_limit; j < j_limit; j++) {
        try {
          Color color = source.GetPixel(location[0] + i, location[1] + j);
          r += color.R;
          g += color.G;
          b += color.B;
          total++;

        } catch {}
      }
    }

    if (total != 0) {
      r /= total;
      g /= total;
      b /= total;
    }
    return Color.FromArgb(r, g, b);
  }

  // draw a triangle given three vertices (UV)
  public static void drawTriangle (Bitmap canvas, Bitmap source, List<int[]> triangleVertices) {
    // Since we mirrored the points across the x axis,
    // the points are now clockwise
    // but we want them to be counter-clockwise
    int[] v0 = triangleVertices[2];
    int[] v1 = triangleVertices[1];
    int[] v2 = triangleVertices[0];

    int minX = min3(v0[0], v1[0], v2[0]);
    int minY = min3(v0[1], v1[1], v2[1]);
    int maxX = max3(v0[0], v1[0], v2[0]);
    int maxY = max3(v0[1], v1[1], v2[1]);

    int[] p = new int[2];
    for (p[1] = minY; p[1] <= maxY; p[1]++) {
      for (p[0] = minX; p[0] <= maxX; p[0]++) {
        // Determine barycentric coordinates
        int w0 = orient2d(v1, v2, p);
        int w1 = orient2d(v2, v0, p);
        int w2 = orient2d(v0, v1, p);

        // If p is on or inside all edges, render pixel.
        if (w0 >= 0 && w1 >= 0 && w2 >= 0) {
          try {
            Color color = source.GetPixel(p[0], p[1]);
            canvas.SetPixel(p[0], p[1], color);
          } catch {}
        }
      }
    }
  }


  // rasterize helper
  public static int orient2d(int[] a, int[] b, int[] c) {
    return (b[0] - a[0]) * (c[1] - a[1]) - (b[1] - a[1]) * (c[0] - a[0]);
  }

  public static int max3 (int a, int b, int c) {
    return Math.Max(a, Math.Max(b, c));
  }

  public static int min3 (int a, int b, int c) {
    return Math.Min(a, Math.Min(b, c));
  }

  public static double[] parseUV(string uv) {
    string[] uv_initial_parsed = uv.Split(UV_DELIMS);
    double[] uv_parsed = { Convert.ToDouble(uv_initial_parsed[1]), Convert.ToDouble(uv_initial_parsed[2])};
    return uv_parsed;
  }

  public static int[] parseFace(string face) {
    string[] init = face.Split(FACE_DELIMS);
    int[] face_parsed = { Convert.ToInt16(init[1]), Convert.ToInt16(init[2]), Convert.ToInt16(init[3])};
    return face_parsed;
  }
# ---------- end c_script_2 ----------
panel_26 = Panel(c_script_2)

replace_4 = ReplaceItems(List=replace_2, Indices=mindex_14.Index, Wrap=False)
item_17 = ListItem(List=replace_4, Index=4, Wrap=True)
